# Grasshopper definition mesh_plots.gh (Grasshopper 1.0.7)

panel = Panel("C:\Users\Mike\Documents\MJJ\Heartflow\heartflow\Model_00_slice_00\mesh_E.txt")
panel_2 = Panel("Height map")
panel_3 = Panel("Color Scheme")
panel_4 = Panel("PATH")
cluster = Cluster(path=panel, A=Slider(0.407, range=0..1), B=Slider(1, range=0..1), A_2=Slider(0, range=0..1), B_2=Slider(1, range=0..1))
mesh = Mesh(cluster)
panel_5 = Panel("C:\Users\Mike\Documents\MJJ\Heartflow\heartflow\Model_00_slice_00\mesh_E.txt")  # disabled
path = FilePath(panel_5)  # disabled
file = ReadFile(File=path, PerLineParse=True)  # disabled
panel_6 = Panel(",")  # disabled
join = TextJoin(Text=file, Join=panel_6)  # disabled
panel_7 = Panel(";")  # disabled
split = TextSplit(Text=join, Separators=panel_7)  # disabled
item = ListItem(List=split, Index=1, Wrap=True)  # disabled
panel_8 = Panel(",")  # disabled
item_2 = ListItem(List=split, Index=0, Wrap=True)  # disabled
item_3 = ListItem(List=split, Index=2, Wrap=True)  # disabled
panel_9 = Panel(",")  # disabled
item_4 = ListItem(List=split, Index=3, Wrap=True)  # disabled
panel_10 = Panel(",")  # disabled
panel_11 = Panel(",")  # disabled
split_2 = TextSplit(Text=item, Separators=panel_8)  # disabled
split_3 = TextSplit(Text=item_3, Separators=panel_9)  # disabled
split_4 = TextSplit(Text=join, Separators=panel_11)  # disabled
split_5 = TextSplit(Text=item_4, Separators=panel_10)  # disabled
number_slider = Slider(0.407, range=0..1)  # disabled
number_slider_2 = Slider(1, range=0..1)  # disabled
item_5 = ListItem(List=split_4, Index=0, Wrap=True)  # disabled
item_6 = ListItem(List=split_4, Index=2, Wrap=True)  # disabled
item_7 = ListItem(List=split_4, Index=1, Wrap=True)  # disabled
number_slider_3 = Slider(0, range=0..1)  # disabled
number_slider_4 = Slider(1, range=0..1)  # disabled
dom = ConstructDomain(DomainStart=number_slider, DomainEnd=number_slider_2)  # disabled
dom_2 = ConstructDomain(DomainStart=number_slider_3, DomainEnd=number_slider_4)  # disabled
dim = Integer(item_5)  # disabled
npts = Integer(item_7)  # disabled
multiplication = Multiplication(A=npts, B=dim)  # disabled
dom_3 = ConstructDomain(DomainStart=1, DomainEnd=multiplication)  # disabled
dom_4 = ConstructDomain(DomainStart=1, DomainEnd=npts)  # disabled
subset = SubList(List=split_2, Domain=dom_3, Wrap=True)  # -> List, Index; disabled
subset_2 = SubList(List=split_5, Domain=dom_4, Wrap=True)  # -> List, Index; disabled
num = Number(subset_2.List)  # disabled
num_2 = Number(subset.List)  # disabled
python = GhPythonScript(x=num)  # -> min, max; inputs x: list; disabled; same code as python
partition = PartitionList(List=num_2, Size=dim)  # disabled
dom_5 = ConstructDomain(DomainStart=python.min, DomainEnd=python.max)  # disabled
remap = RemapNumbers(Value=num, Source=dom_5, Target=dom)  # -> Mapped, Clipped; disabled
remap_2 = RemapNumbers(Value=num, Source=dom_5, Target=dom_2)  # -> Mapped, Clipped; disabled
subtraction = Subtraction(A=1, B=remap.Clipped)  # disabled
item_8 = ListItem(List=partition, Index=1, Wrap=True)  # disabled
item_9 = ListItem(List=partition, Index=2, Wrap=True)  # disabled
item_10 = ListItem(List=partition, Index=0, Wrap=True)  # disabled
hsv = ColourHSV(Alpha=1, Hue=subtraction, Saturation=1, Value=1)  # disabled
ntris = Integer(item_6)  # disabled
multiplication_2 = Multiplication(A=ntris, B=3)  # disabled
dom_6 = ConstructDomain(DomainStart=1, DomainEnd=multiplication_2)  # disabled
subset_3 = SubList(List=split_3, Domain=dom_6, Wrap=True)  # -> List, Index; disabled
int = Integer(subset_3.List)  # disabled
partition_2 = PartitionList(List=int, Size=3)  # disabled
item_11 = ListItem(List=partition_2, Index=0, Wrap=True)  # disabled
item_12 = ListItem(List=partition_2, Index=2, Wrap=True)  # disabled
item_13 = ListItem(List=partition_2, Index=1, Wrap=True)  # disabled
triangle = MeshTriangle(CornerA=item_11, CornerB=item_13, CornerC=item_12)  # -> flatten(Face); disabled
face = MeshFace(triangle)  # disabled
pt = ConstructPoint(XCoordinate=item_10, YCoordinate=item_8, ZCoordinate=item_9)  # -> flatten(Point); disabled
col = Colour(hsv)  # disabled
python_2 = GhPythonScript(dim=dim, pts=pt, vals=remap_2.Clipped)  # -> pts; inputs pts: list of Point3d, vals: list; disabled; same code as python_2
pt_2 = Point(python_2)  # disabled
panel_12 = Panel(pt_2)  # disabled
panel_13 = Panel(face)  # disabled
panel_14 = Panel(dim)  # disabled
panel_15 = Panel(ntris)  # disabled
panel_16 = Panel(npts)  # disabled
conmesh = ConstructMesh(Vertices=pt_2, Faces=face, Colours=col)  # disabled

# ==== cluster Cluster
path = ClusterInput()
path_2 = FilePath(path)
file = ReadFile(File=path_2, PerLineParse=True)
join = TextJoin(Text=file, Join=",")
split = TextSplit(Text=join, Separators=";")
item = ListItem(List=split, Index=1, Wrap=True)
item_2 = ListItem(List=split, Index=0, Wrap=True)
item_3 = ListItem(List=split, Index=2, Wrap=True)
item_4 = ListItem(List=split, Index=3, Wrap=True)
split_2 = TextSplit(Text=item, Separators=",")
split_3 = TextSplit(Text=item_3, Separators=",")
split_4 = TextSplit(Text=join, Separators=",")
split_5 = TextSplit(Text=item_4, Separators=",")
item_5 = ListItem(List=split_4, Index=0, Wrap=True)
item_6 = ListItem(List=split_4, Index=2, Wrap=True)
item_7 = ListItem(List=split_4, Index=1, Wrap=True)
A = ClusterInput()
B = ClusterInput()
dom = ConstructDomain(DomainStart=A, DomainEnd=B)
A_2 = ClusterInput()
B_2 = ClusterInput()
dom_2 = ConstructDomain(DomainStart=A_2, DomainEnd=B_2)
dim = Integer(item_5)
npts = Integer(item_7)
multiplication = Multiplication(A=npts, B=dim)
dom_3 = ConstructDomain(DomainStart=1, DomainEnd=multiplication)
dom_4 = ConstructDomain(DomainStart=1, DomainEnd=npts)
subset = SubList(List=split_2, Domain=dom_3, Wrap=True)  # -> List, Index
subset_2 = SubList(List=split_5, Domain=dom_4, Wrap=True)  # -> List, Index
num = Number(subset_2.List)
num_2 = Number(subset.List)
python = GhPythonScript(x=num)  # -> min, max; inputs x: list
# ---------- python: Python ----------
__author__ = "Mike"
__version__ = "2020.11.17"

min = x[0]
max = x[0]
for xx in x:
    if xx < min:
        min = xx
    if xx > max:
        max = xx
# ---------- end python ----------
partition = PartitionList(List=num_2, Size=dim)
dom_5 = ConstructDomain(DomainStart=python.min, DomainEnd=python.max)
remap = RemapNumbers(Value=num, Source=dom_5, Target=dom)  # -> Mapped, Clipped
remap_2 = RemapNumbers(Value=num, Source=dom_5, Target=dom_2)  # -> Mapped, Clipped
subtraction = Subtraction(A=1, B=remap.Clipped)
item_8 = ListItem(List=partition, Index=1, Wrap=True)
item_9 = ListItem(List=partition, Index=2, Wrap=True)
item_10 = ListItem(List=partition, Index=0, Wrap=True)
hsv = ColourHSV(Alpha=1, Hue=subtraction, Saturation=1, Value=1)
ntris = Integer(item_6)
multiplication_2 = Multiplication(A=ntris, B=3)
dom_6 = ConstructDomain(DomainStart=1, DomainEnd=multiplication_2)
subset_3 = SubList(List=split_3, Domain=dom_6, Wrap=True)  # -> List, Index
int = Integer(subset_3.List)
partition_2 = PartitionList(List=int, Size=3)
item_11 = ListItem(List=partition_2, Index=0, Wrap=True)
item_12 = ListItem(List=partition_2, Index=2, Wrap=True)
item_13 = ListItem(List=partition_2, Index=1, Wrap=True)
triangle = MeshTriangle(CornerA=item_11, CornerB=item_13, CornerC=item_12)  # -> flatten(Face)
face = MeshFace(triangle)
pt = ConstructPoint(XCoordinate=item_10, YCoordinate=item_8, ZCoordinate=item_9)  # -> flatten(Point)
col = Colour(hsv)
python_2 = GhPythonScript(dim=dim, pts=pt, vals=remap_2.Clipped)  # -> pts; inputs pts: list of Point3d, vals: list
# ---------- python_2: Python ----------
__author__ = "Mike"
__version__ = "2020.11.17"

import rhinoscriptsyntax as rs
import ghpythonlib.components as ghc

if dim==2:
    for i in range(len(pts)):
        pts[i] = ghc.ConstructPoint(pts[i][0], pts[i][1], vals[i])
# ---------- end python_2 ----------
pt_2 = Point(python_2)
panel = Panel(pt_2)
panel_2 = Panel(face)
panel_3 = Panel(dim)
panel_4 = Panel(ntris)
panel_5 = Panel(npts)
conmesh = ConstructMesh(Vertices=pt_2, Faces=face, Colours=col)
M = ClusterOutput(conmesh)
