# Grasshopper definition test_trimesh_sdf.gh (Grasshopper 1.0.7)

neg = Negative(Value=Slider(185.8867858, range=0..1000))
neg_2 = Negative(Value=Slider(179.8867858, range=0..1000))
dom = ConstructDomain(DomainStart=Slider(632.1077093, range=0..1000), DomainEnd=Slider(638.1077093, range=0..1000))
dom_2 = ConstructDomain(DomainStart=Slider(36.35025103, range=0..100), DomainEnd=Slider(42.35025103, range=0..100))
dom_3 = ConstructDomain(DomainStart=neg, DomainEnd=neg_2)
random = Random(Range=dom, Number=1, Seed=2)
random_2 = Random(Range=dom_2, Number=1, Seed=2)
random_3 = Random(Range=dom_3, Number=1, Seed=2)
pt = ConstructPoint(XCoordinate=random_2, YCoordinate=random_3, ZCoordinate=random)
geo = Geometry(<point referenced from the Rhino model>)
mesh = Mesh(<mesh referenced from the Rhino model>)
number_slider = Slider(0.04, range=0..1)
vec = VectorXYZ(XComponent=0, YComponent=0, ZComponent=0)  # -> Vector, Length
addition = Addition(A=geo, B=vec.Vector)
neg_3 = Negative(Value=Slider(183.7434128, range=0..1000))
pt_2 = ConstructPoint(XCoordinate=Slider(38.3698624, range=0..100), YCoordinate=neg_3, ZCoordinate=Slider(636.7126755, range=0..1000))
pt_3 = Point(addition)
sph = Sphere(Base=geo, Radius=number_slider)
number_slider_2 = Slider(0.018, range=0..1)
pt_4 = Point(pt_2)
panel = Panel("Point")
panel_2 = Panel(pt_3)
demesh = DeconstructMesh(Mesh=mesh)  # -> Vertices, Faces, Colours, Normals
meshcp = MeshClosestPoint(Point=geo, Mesh=mesh)  # -> Point, Index, Parameter
panel_4 = Panel(pt_4)
item = ListItem(List=demesh.Faces, Index=Slider(0, range=0..100), Wrap=True)
dist = Distance(PointA=meshcp.Point, PointB=geo)
sph_2 = Sphere(Base=meshcp.Point, Radius=number_slider)
deface = DeconstructFace(Face=item)  # -> CornerA, CornerB, CornerC, CornerD
panel_7 = Panel("Projected Point")
panel_8 = Panel(meshcp.Point)
meshcp_2 = MeshClosestPoint(Point=pt_4, Mesh=mesh)  # -> Point, Index, Parameter
sph_3 = Sphere(Base=pt_4, Radius=number_slider_2)
dist_2 = Distance(PointA=pt_4, PointB=meshcp_2.Point)
item_2 = ListItem(List=demesh.Vertices, Index=[deface.CornerA, deface.CornerB, deface.CornerC], Wrap=True)
panel_10 = Panel(meshcp_2.Point)
sph_4 = Sphere(Base=meshcp_2.Point, Radius=number_slider_2)
conmesh = ConstructMesh(Vertices=item_2, Faces=item)
panel_12 = Panel("Distance")
panel_13 = Panel(dist)
meshcp_3 = MeshClosestPoint(Point=pt_4, Mesh=conmesh)  # -> Point, Index, Parameter
panel_14 = Panel(meshcp_3.Point)
sph_5 = Sphere(Base=meshcp_3.Point, Radius=number_slider_2)
preview = CustomPreview(Geometry=sph_3, Material=ColourSwatch(SwatchColor=RGB(0, 0, 0)))
preview_2 = CustomPreview(Geometry=sph_4, Material=ColourSwatch(SwatchColor=RGB(255, 0, 0)))
preview_3 = CustomPreview(Geometry=sph, Material=ColourSwatch(SwatchColor=RGB(30, 156, 5)))
preview_4 = CustomPreview(Geometry=sph_2, Material=ColourSwatch(SwatchColor=RGB(255, 0, 225)))
panel_16 = Panel(dist_2)
preview_5 = CustomPreview(Geometry=sph_5, Material=ColourSwatch(SwatchColor=RGB(0, 30, 255)))
dist_3 = Distance(PointA=pt_4, PointB=meshcp_3.Point)
panel_18 = Panel(dist_3)
